# Grasshopper definition nestingbb.gh (Grasshopper 1.0.7)

number_slider = Slider(3, range=1..3)
vector_xyz = VectorXYZ(XComponent=0, YComponent=0, ZComponent=Slider(-0.782, range=-1..1))  # -> Vector, Length
curve = Curve(<curve referenced from the Rhino model>)
linear_array = LinearArray(Geometry=curve, Direction=vector_xyz.Vector, Count=number_slider)  # -> Geometry, Transform
series = Series(Start=1, Step=2, Count=number_slider)
panel = Panel(linear_array.Geometry)
scale = Scale(Geometry=linear_array.Geometry, Center=Point(0, 0, 0), Factor=series)  # -> Geometry, Transform
panel_2 = Panel(series)
offset_curve = OffsetCurve(Curve=scale.Geometry, Distance=Slider(-2, range=-3..3), Plane=PlaneXY(0, 0, 0), Corners=1)
merge = Merge(Data1=graft(scale.Geometry), Data2=offset_curve)
panel_3 = Panel(offset_curve)
boundary_surfaces = BoundarySurfaces(Edges=offset_curve)
wallheight = Slider(19.891, range=1..50)
panel_4 = Panel(merge)
boundary_surfaces_2 = BoundarySurfaces(Edges=merge)
vector_xyz_2 = VectorXYZ(XComponent=0, YComponent=0, ZComponent=wallheight)  # -> Vector, Length
extrude = Extrude(Base=boundary_surfaces_2, Direction=vector_xyz_2.Vector)
panel_5 = Panel(extrude)
taper = Taper(
    Geometry=extrude,
    Axis=Line((0, 0, 0), (0, 0, 50)),
    Start=Slider(1, range=-20..20),
    End=Slider(1.1, range=-20..20),
    Flat=False,
    Infinite=Toggle(True),
    Rigid=False)
